# Grasshopper definition portal-example.gh (Grasshopper 1.0.7)
# plug-ins: Portal.Gh

concat = Concatenate(FragmentA="hey there from meory ", FragmentB=Slider(2380, range=0..10000))
# Memory Mapped File
panel = Panel("TestMemoryBlock")
# WebSocket
number_slider = Slider(6001, range=0..10000)
# UDP
number_slider_2 = Slider(6000, range=0..10000)
enbytes = BytesEncoder(Text=concat)
# Pipe
panel_2 = Panel("TestPipe")
enbytes_2 = BytesEncoder(Text="hey there from pipe")
enbytes_3 = BytesEncoder(Text="hey there from ws client")
enbytes_4 = BytesEncoder(Text="hey there from client 4")
memory = SharedMemoryWriter(MemoryName=panel, Bytes=enbytes, Write=Toggle(False))
pipe = NamedPipeSender(ServerName=".", PipeName=panel_2, Bytes=enbytes_2, Send=Button())
udp = UDPSender(ServerIP="127.0.0.1", Port=number_slider_2, Bytes=enbytes_4, Send=Button())
ws_client = WebSocketClient(HostIP="127.0.0.1", Port=number_slider, Route="/test", Bytes=enbytes_3, Send=Button())
pipe_2 = NamedPipeReceiver(PipeName=panel_2, BufferSize=4096, Start=Toggle(False))
ws_server = WebSocketServer(Port=number_slider, Route="/test", Start=Toggle(False))
udp_2 = UdpReceiver(Port=number_slider_2, Start=Toggle(False))
memory_2 = SharedMemoryAutoReader(MemoryName=panel, Interval=Slider(200, range=0..1000), Start=Toggle(False))
memory_3 = SharedMemoryReader(MemoryName=panel, Start=Button())
debytes = BytesDecoder(Bytes=pipe_2)
debytes_2 = BytesDecoder(Bytes=ws_server)
debytes_3 = BytesDecoder(Bytes=udp_2)
debytes_4 = BytesDecoder(Bytes=memory_2)
panel_3 = Panel(debytes)
dsrlzpt = DeserializePoints()
debytes_5 = BytesDecoder(Bytes=memory_3)
panel_4 = Panel(debytes_2)
panel_5 = Panel(debytes_3)
panel_6 = Panel(debytes_4)
panel_7 = Panel(debytes_5)
crv = Curve(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)
mesh = Mesh(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)
pt = Point([Point(2.174324685, -5.670873841, 0), Point(6.052849799, -3.32025256, 0), Point(-0.3525931922, -0.9108657465, 0), Point(-4.936304691, -1.145927875, 0), Point(-7.463222568, -5.141984053, 0), Point(-1.057779577, -8.080260655, 0), Point(6.111615331, -8.315322783, 0), Point(0.9402485125, -5.494577245, 0), Point(-1.880497025, -2.438769579, 0), Point(2.585683409, 2.908893836, 0), Point(-5.347663415, 5.729639373, 0), Point(-9.872609382, 3.379018092, 0), Point(-13.16347918, -1.557286599, 0), Point(-16.10175578, -5.905935969, 0), Point(-11.75310641, -8.961743635, 0), Point(-5.700256607, -9.490633423, 0)])
srlzcrv = SerializeCurve(Curves=crv)
srlzmesh = SerializeMesh(Mesh=mesh)
srlzpt = SerializePoints(Points=pt)
enbytes_5 = BytesEncoder(Text=srlzcrv)
txtsize = TextSize(Data=srlzcrv)
bcompress = CompressBytes(StringData=enbytes_5)
datainfo = DataInformation(Data=srlzmesh)
panel_8 = Panel(srlzpt)
panel_9 = Panel(srlzmesh)
info = NetworkInfo()  # -> Properties, LocalIP
panel_10 = Panel(srlzcrv)
panel_11 = Panel(txtsize)
file = FileReader(FilePath="F:\projects\voxel-analyser\voxels_with_slope.json")
bytes = Bytes(bcompress)
panel_12 = Panel(info.Properties)
bdecompress = DecompressBytes(Bytes=bytes)
compbytes = CompressBytes(Bytes=file)
dsrlzcrv = DeserializeCurve(JsonData=srlzcrv)
dsrlzpt_2 = DeserializePoints(JsonData=srlzpt)
dsrlzmesh = DeserializeMesh(JsonData=srlzmesh)
debytes_6 = BytesDecoder(Bytes=bdecompress)
bdecompress_2 = DecompressBytes(Bytes=compbytes)
panel_13 = Panel(dsrlzmesh)
panel_14 = Panel(dsrlzpt_2)
panel_15 = Panel(dsrlzcrv)
panel_16 = Panel(debytes_6)
debytes_7 = BytesDecoder(Bytes=bdecompress_2)
